# Grasshopper definition AGGREGATE.gh (Grasshopper 1.0.7)
# plug-ins: FileToScript

panel = Panel("BeaverComponent.cs")  # disabled
dir_type = ValueList({"desktop": 0, "documents": 1, "GH file path": 2, "C:": 3}, selected="GH file path")  # disabled
f_ghfilepath = GHFilePathInfo()  # -> F, P; disabled
# ---------- f_ghfilepath: C# ----------
                                      /*
    froGH - a sparse collection of (in)utilities for Grasshopper

    GH File and Path info

    code by Alessio Erioli

    froGH by Co-de-iT is licensed under a Creative Commons Attribution 4.0 International License.
    http://creativecommons.org/licenses/by/4.0/

    */

    initComp();

    GH_Document ghDoc = Grasshopper.Instances.ActiveCanvas.Document;

    int nameLen = ghDoc.DisplayName.TrimEnd('*').Length + 3; // +3 accounts for the '.gh' extension
    int fileLen = ghDoc.FilePath.TrimEnd('*').Length;

    F = ghDoc.DisplayName.TrimEnd('*');
    P = ghDoc.FilePath.Substring(0, fileLen - nameLen);
# ---------- f_ghfilepath: C# additional code ----------
  void initComp(){

    Component.Name = "GH File Path Info";
    Component.NickName = "f_GHFilePath";
    Component.Description = "Provides info on current Grasshopper Document file name and path\nUseful for exporting files with the same name as the gh file and in the same directory";
    Component.Params.Output[0].Name = "File Name";
    Component.Params.Output[0].Description = "Current GH file name";
    Component.Params.Output[1].Name = "File Path";
    Component.Params.Output[1].Description = "Current GH file path";
  }
# ---------- end f_ghfilepath ----------
panel_2 = Panel("Beaver\Beaver")  # disabled
panel_3 = Panel(f_ghfilepath.P)  # disabled
f_pathg = PathGenerator(type=dir_type, subDir=panel_2)  # -> dir; inputs type: Int32, subDir: String; disabled
# ---------- f_pathg: C# ----------
                           /*
    froGH - a sparse collection of (in)utilities for Grasshopper

    Path Generator
    code by Alessio Erioli - value list generation based on code by James Ramsden

    froGH by Co-de-iT is licensed under a Creative Commons Attribution 4.0 International License.
    http://creativecommons.org/licenses/by/4.0/

    */
    initComp();


    String S = "";
    String root = "";
    String end = "\\";
    String eol = Environment.NewLine;

    // __________________ autoList part __________________

    // variable for the list
    Grasshopper.Kernel.Special.GH_ValueList vList;
    // tries to cast input as list
    try{

      // if the list is not the first parameter then change Input[0] to the corresponding value
      vList = (Grasshopper.Kernel.Special.GH_ValueList) Component.Params.Input[0].Sources[0];
      // Print("value list connected");
      // check if the list must be created
      //if (vList.NickName != "dir type"){
      if (!vList.NickName.Equals("dir type")){
        vList.ClearData();
        vList.ListItems.Clear();
        vList.NickName = "dir type";
        var item1 = new Grasshopper.Kernel.Special.GH_ValueListItem("desktop", "0");
        var item2 = new Grasshopper.Kernel.Special.GH_ValueListItem("documents", "1");
        var item3 = new Grasshopper.Kernel.Special.GH_ValueListItem("GH file path", "2");
        var item4 = new Grasshopper.Kernel.Special.GH_ValueListItem("C:", "3");
        vList.ListItems.Add(item1);
        vList.ListItems.Add(item2);
        vList.ListItems.Add(item3);
        vList.ListItems.Add(item4);

        vList.ListItems[0].Value.CastTo(out type);
      }
    }
    catch{
      // handles anything that is not a value list
    }


    switch(type){
      case 0:
        root = Environment.GetFolderPath(Environment.SpecialFolder.Desktop) + end;
        S = "Desktop";
        break;
      case 1:
        root = Environment.GetFolderPath(Environment.SpecialFolder.MyDocuments) + end;
        S = "Documents";
        break;
      case 2:
        GH_Document ghDoc = owner.OnPingDocument();

        if (ghDoc.IsFilePathDefined)
        {
          int nameLen = ghDoc.DisplayName.TrimEnd('*').Length + 3; // +3 accounts for the '.gh' extension
          int fileLen = ghDoc.FilePath.TrimEnd('*').Length;

          //F = ghDoc.DisplayName.TrimEnd('*');
          root = ghDoc.FilePath.Substring(0, fileLen - nameLen);
          //root = gh_d.FilePath;
          S = "GH File path";
        }
        else
        {
          Print("No path defined. Saving to Desktop until then");
          root = Environment.GetFolderPath(Environment.SpecialFolder.Desktop);
          S = "Desktop";
        }
        break;
      case 3:
        root = "C:" + end;
        S = root + end;
        break;
    }
    dir = root + (subDir != null ? (subDir + end) : "");
    Component.Message = S;
# ---------- f_pathg: C# additional code ----------
  void initComp(){
    Component.Name = "Path Generator";
    Component.NickName = "f_PathG";
    Component.Description = "generates a path based on local direcories such as Desktop, Documents, GH file path";
    Component.Params.Input[0].Name = "dir type";
    Component.Params.Input[0].Description = "directory type: 0 desktop, 1 documents, 2 GH file path, 3 C:\nconnect a value list for automatic list generation";
    Component.Params.Input[1].Name = "custom subdir";
    Component.Params.Input[1].Description = "(optional) custom subdirectory";
  }
# ---------- end f_pathg ----------
concat = Concatenate(FragmentA=f_pathg, FragmentB=panel)  # disabled

panel_4 = Panel("D:\DESIGN BY DATA\COURSE\97_THESIS\AGGREGATE\BEAVER\BEAVER\BEAVER.cs")
number_slider = Slider(100, range=0..100, expression="x*3")
dom = ConstructDomain(DomainStart=Slider(0.03, range=0..1), DomainEnd=Slider(0.1, range=0..10))
dom_2 = ConstructDomain(DomainStart=Slider(0.7, range=0..1), DomainEnd=Slider(3.1, range=0..10))
dom_3 = ConstructDomain(DomainStart=Slider(0.03, range=0..1), DomainEnd=Slider(0.1, range=0..10))
series = Series(Start=0, Step=1, Count=number_slider)  # -> flatten(Series)
random = Random(Range=dom, Number=number_slider, Seed=Slider(3, range=0..10))  # -> flatten(Random)
random_2 = Random(Range=dom_2, Number=number_slider, Seed=2)  # -> flatten(Random)
random_3 = Random(Range=dom_3, Number=number_slider, Seed=2)  # -> flatten(Random)
pt = ConstructPoint(XCoordinate=0, YCoordinate=0, ZCoordinate=0)
concat_2 = Concatenate(FragmentB=series)
dup = DuplicateData(Data=pt, Number=number_slider, Order=True)
path = FilePath(panel_4)
panel_5 = Panel(random_2)
panel_6 = Panel(series)
c_script = CSharpScript(p=dup, id=series, l=random_2, w=random_3, t=random)  # -> out, A, B, C, D, E; inputs p: list of Point3d, id: list of Int32, l: list of Double, w: list of Double, t: list of Double
# ---------- c_script: C# usings ----------
using System.Linq;
# ---------- c_script: C# ----------
        IList<int> ID = new List<int>(_id);
        IList<double> L = new List<double>(_l);
        IList<double> W = new List<double>(_w);
        IList<double> T = new List<double>(_t);
        int IDLength = ID.Count;

        List<element> bars = new List<element>();
        for (int i = 0; i < IDLength; i+=1)
        {
            element bar = new element(ID[i], L[i], W[i], T[i]);
            bars.Add(bar);
        }

        List<double> barsVolumes = new List<double>();
        for (int i = 0; i < IDLength; i++)
        {
            double volume = bars.ElementAt(i).Volume;
            barsVolumes.Add(volume);
        }


        IList<element> barList = bars;

        barList.OrderBy(i => barsVolumes);

        IList<int> orderedID = new List<int>();
            for (int i = 0; i<IDLength ;i++)
        {
            int id = bars.ElementAt(i).Id;
            orderedID.Add(id);
        }

        IList<aggregate> aggregateList = new List<aggregate>();
        
        
        for (int i = 0; i < IDLength-1; i+=3)
        {
            aggregate agg = new aggregate(barList, i);
            aggregateList.Add(agg);
        }

        IList<string> aggNameList = new List<string>();
        for (int i = 0; i<aggregateList.Count ; i++ )
        {
            aggNameList.Add(aggregateList.ElementAt(i).Name);
        }

        A = bars.Count;
        B = IDLength;
        C = aggregateList;
        D = barsVolumes;
        E = aggNameList;
# ---------- c_script: C# additional code ----------
 
    public class Assembly
    {
        //Fields

        private List<Point3d> _assFSpot;
        public List<Point3d> FSpot
        {
            get { return _assFSpot; }
            set { _assFSpot = value; }
        }

        private List<Point3d> _assNfSpot;
        public List<Point3d> NfSpot
        {
            get { return _assNfSpot; }
            set { _assNfSpot = value; }
        }

        private List<int> _assDof;
        public List<int> Dof
        {
            get { return _assDof; }
            set { _assDof = value; }
        }
        //List of freedom degrees for each points : int
        //List of aggregate

        //Constructor
        public Assembly()
        {
            
        }
        //public assembly(list<aggregate> aggregates)
        //{
        //this.ass_aggregate = aggregates;
        //}

        //Methods

        //A method to evaluate freedom degrees of existing aggregate
        //A method to add an aggregate to the the assembly 
    }

    public class aggregate
{
    //Fields

    private element[] agg_Arrelements;
    public element[] ArrElements
    {
        get { return agg_Arrelements; }
        set { agg_Arrelements = value; }
    }

    private Point3d agg_initPos;
    public Point3d InitPos
    {
        get { return agg_initPos; }
        set { agg_initPos = value; }
    }

    private string agg_name;
    public string Name
    {
        get { return agg_name; }
        set { agg_name = value; }
    }

    private int _aggXFreedom;
    public int XFreedom
    {
        get { return _aggXFreedom; }
        set { _aggXFreedom = 3; }
    }

    private int _aggYFreedom;
    public int YFreedom
    {
        get { return _aggYFreedom; }
        set { _aggYFreedom = 3; }
    }

    private int _aggZFreedom;
    public int ZFreedom
    {
        get { return _aggZFreedom; }
        set { _aggZFreedom = 3; }
    }

    private double _aggXFsPos;
    public double XFsPos
    {
        get { return _aggXFsPos; }
        set { _aggXFsPos = value; }
    }

    private double _aggYFsPos;
    public double YFsPos
    {
        get { return _aggYFsPos; }
        set { _aggYFsPos = value; }
    }

    private double _aggZFsPos;
    public double ZFsPos
    {
        get { return _aggZFsPos; }
        set { _aggZFsPos = value; }
    }


    //Constructor
    public aggregate()
    {

    }

    public aggregate(IList<element> elements, int i)
    {
        this.ArrElements = Aggregation(elements, i);
        this.Name = "agg_" + i/3;
        
    }


    //Methods

    public element[] Aggregation(IList<element> element, int i)
    {
        element[] arrelements = new element[3] { element[i], element[i + 1], element[i + 2] };
        return arrelements;
    }

    //A method to place element along x,y,z axis

    //A method to get information from the elements

    //A method to give building instruction of the aggregate




    
}
/// <summary> Nested Class elements
/// Nested Class elements
/// </summary>
public class element
{
    //Fields 

    private int ele_Id;
    public int Id
    {
        get { return ele_Id; }
        set { ele_Id = value; }
    }

    private double ele_Length;
    public double Length
    {
        get { return ele_Length; }
        set { ele_Length = value; }
    }

    private double ele_Width;
    public double Width
    {
        get { return ele_Width; }
        set { ele_Width = value; }
    }

    private double ele_Thickness;
    public double Thickness
    {
        get { return ele_Thickness; }
        set { ele_Thickness = value; }
    }

    private double ele_Volume;
    public double Volume
    {
        get { return ele_Volume; }
        set { ele_Volume = value; }
    }

    private int ele_Orientation;
    public int Orientation
    {
        get { return ele_Orientation; }
        set { ele_Orientation = value; }
    }

    private Box ele_Box;
    public Box Box
    {
        get { return ele_Box; }
        set { ele_Box = value; }
    }


    //Constructor
    public element()
    {

    }

    public element(int id, double l, double w, double t)
    {
        this.Id = id;
        this.Length = l;
        this.Width = w;
        this.Thickness = t;
        this.Box = Bars(Length, Width, Thickness);
        this.Volume = Box.Volume;
    }


    //Methods

    /// <summary>
    /// This function create 3D geometry representing the bar
    /// </summary>
    public Box Bars(double l, double w, double t)
    {
        Interval lInterval = new Interval(0, l);
        Interval wInterval = new Interval(0, w);
        Interval tInterval = new Interval(0, t);
        Rhino.Geometry.Plane pPlane = new Plane(1, 0, 0, 0);
        Rhino.Geometry.Box box = new Box(pPlane, lInterval, wInterval, tInterval);
        return box;
    }

}
// utilities functions

/// <summary>
/// This Function maps a value from a source domain to a destination domain. Written by Alessio Erioli from Co-De-It
/// </summary>
/// <param name="val">the value</param>
/// <param name="fromMin">low value of source domain</param>
/// <param name="fromMax">high value of source domain</param>
/// <param name="toMin">low value of destination domain</param>
/// <param name="toMax">high value of destination domain</param>
/// <returns>the remapped value</returns>
//public double Map(double val, double fromMin, double fromMax, double toMin, double toMax)
//{
//    return toMin + (val - fromMin) * (toMax - toMin) / (fromMax - fromMin);
//}

/// <summary>
/// This function intend to vizualise wood bars stock.
/// </summary>

///<summary> This function intend to compare list and order one according to the other.
///
/// </summary>
# ---------- end c_script ----------
ftsv2 = FileToScriptV2(File=path)
lng = ListLength(List=c_script.A)
panel_7 = Panel(random_3)
panel_8 = Panel(random)
panel_9 = Panel(c_script.E)
panel_10 = Panel(c_script.B)
panel_11 = Panel(c_script.D)
panel_12 = Panel(c_script.C)
panel_13 = Panel(c_script.A)
